# Dynamo graph pix2pix-dynaweb-request.dyn "Dynamo 2.0 - 6 - Complex POST request" (Dynamo 2.0.2.6826)

# group: Serialize Input Image to base64
file_path = Filename(".\flower.png")
python_script = Python(IN[0]=file_path)
# ---------- python_script.python (14 lines) ----------
import clr
import binascii
clr.AddReference("DSCoreNodes")
import DSCore
from DSCore import *
import sys
sys.path.append('C:\\Program\ Files\ (x86)\\IronPython\ 2.7\\Lib')

image_data = open(IN[0], "r").read()
# base64 = binascii.b2a_base64(image_data)

bbase64 = binascii.b2a_base64(image_data)

OUT = bbase64
# ----------------------------------------
watch_base64_input_image = Watch(python_script)
file_from_path = FileObject(path=file_path)
readFromFile = Image.ReadFromFile(file=file_from_path)
watch_image = WatchImageCore(image=readFromFile)

# group: Web Request to pix2pix-tensorflow Docker Service (using DynaWeb)
string = StringInput("http://f78a9365.ngrok.io")
code_block = CodeBlock(ngrok=string) { ngrok+"/pix64json"; }
byUrl = DynaWeb.WebRequest.ByUrl(url=code_block, lacing=Shortest)
string_2 = StringInput("POST")
setMethod = DynaWeb.WebRequest.SetMethod(webRequest=byUrl, method=string_2, lacing=Shortest)
addJsonBody = DynaWeb.WebRequest.AddJsonBody(webRequest=setMethod, obj=watch_base64_input_image)
string_3 = StringInput("Content-Type")
string_4 = StringInput("application/json")
addHeader = DynaWeb.WebRequest.AddHeader(webRequest=addJsonBody, name=string_3, value=string_4, lacing=Shortest)
execute = DynaWeb.WebRequest.Execute(request=addHeader, lacing=Shortest)
content = DynaWeb.WebResponse.Content(webResponse=execute, lacing=Shortest)

# group: Deserialize Output Image from base64
watch = Watch(content)
python_script_2 = Python(IN[0]=watch)
# ---------- python_script_2.python (22 lines) ----------
import clr
import binascii
clr.AddReference("DSCoreNodes")
import DSCore
from DSCore import *
import sys
sys.path.append('C:\\Program\ Files\ (x86)\\IronPython\ 2.7\\Lib')




BinStr = binascii.a2b_base64(IN[0])

#https://stackoverflow.com/questions/12517451/automatically-creating-directories-with-file-output
# cwd = dir_path = os.path.dirname(os.path.realpath(__file__))
filename = 'C:\\users\\martinno\\files\\Logotest.png'


logo = open(filename,"wb")
logo.write(BinStr)
logo.close()
OUT = filename
# ----------------------------------------
file_from_path_2 = FileObject(path=python_script_2)
readFromFile_2 = Image.ReadFromFile(file=file_from_path_2)
watch_image_2 = WatchImageCore(image=readFromFile_2)

# note: The "WebRequest.ByURL" node in the DynaWeb Dynamo library builds a web request to the URL provided.
# This node also defaults to building a GET request, but this can be overriden after the request is built using the "WebRequest.SetMethod" node, see the more advanced samples.
# note: I suggest using something like RequestBin to test out the package and web responses.
# https://requestb.in/
# Visit the site to generate a fresh URL, this one will likely be out of date.
# Using such a service will allow you to see how different parts of the request would be received by the server.
# I also recommend using the Postman app (https://www.getpostman.com) to figure out how to interact with a REST API first. Once you have it working in Postman, replicating those settings using DynaWeb will be trivial since the nomenclature is pretty much the same.
string_5 = StringInput("http://5cfb27d8.ngrok.io")
# note: The "WebRequest.Execute" node in the DynaWeb Dynamo library simply executes the web request it is given. It expects a valid WebRequest as input.
byUrl_2 = DynaWeb.WebRequest.ByUrl(url=string_5, lacing=Shortest)

# group: Execute the request
execute_2 = DynaWeb.WebRequest.Execute(request=byUrl_2, lacing=Shortest)  # frozen

# group: Response metadata
cookies = DynaWeb.WebResponse.Cookies(webResponse=execute_2, lacing=Shortest)
watch_2 = Watch(cookies)
headers = DynaWeb.WebResponse.Headers(webResponse=execute_2, lacing=Shortest)
watch_3 = Watch(headers)
server = DynaWeb.WebResponse.Server(webResponse=execute_2, lacing=Shortest)
responseUri = DynaWeb.WebResponse.ResponseUri(webResponse=execute_2, lacing=Shortest)
statusDescription = DynaWeb.WebResponse.StatusDescription(webResponse=execute_2, lacing=Shortest)
responseStatus = DynaWeb.WebResponse.ResponseStatus(webResponse=execute_2, lacing=Shortest)
statusCode = DynaWeb.WebResponse.StatusCode(webResponse=execute_2, lacing=Shortest)
content_2 = DynaWeb.WebResponse.Content(webResponse=execute_2, lacing=Shortest)
watch_4 = Watch(content_2)

string_6 = StringInput("POST")

# group: Set HTTP method
string_7 = StringInput("GET")
# note: The HTTP methods supported by DynaWeb are :
# GET
# POST
# PUT
# DELETE
# HEAD
# OPTIONS
# PATCH
# MERGE
setMethod_2 = DynaWeb.WebRequest.SetMethod(webRequest=byUrl_2, method=string_7, lacing=Shortest)

code_block_2 = CodeBlock()
# ---------- code_block_2.designscript (1 lines) ----------
"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";
# ----------------------------------------

# group: Adding a parameter to URL
code_block_3 = CodeBlock(base64=code_block_2) { "contentImage"; base64; }
addQueryParameter = DynaWeb.WebRequest.AddQueryParameter(webRequest=setMethod_2, name=code_block_3.out0, value=code_block_3.base64, lacing=Shortest)

# group: Tell the server we're sending JSON data
string_8 = StringInput("Content-Type")
# note: Most REST API services will not only return this header, but also require it.
string_9 = StringInput("application/json")
addHeader_2 = DynaWeb.WebRequest.AddHeader(webRequest=addQueryParameter, name=string_8, value=string_9, lacing=Shortest)

# group: Time it took for Request to execute
time = DynaWeb.WebResponse.Time(webResponse=execute_2, lacing=Shortest)

# group: Response
# note: The Execute node from the DynaWeb package returns a WebResponse object. This object contains all the metadata of the response as well as the content itself.
# The WebResponse.Content node returns the actual content returned from the server.
# In this example, the server does not return HTML to us, but a simple ok.
# Please see the following image in the samples folder to get a sense of what the server will be receiving when this request is executed :
# 6 - Complex POST request server-side.PNG
content_3 = DynaWeb.WebResponse.Content(webResponse=execute_2, lacing=Shortest)
watch_5 = Watch(content_3)
